# Dynamo graph Excel_IO-211020.dyn (Dynamo 2.10.0.3455)

excel_file_path = StringInput("F:\_NGHIEN CUU\_Github\py_dynamo_revit\excel_IO\Book1.xlsx")
sheet_name = StringInput("Sheet1")
show_excel = BoolSelector(true)
python_script = Python(IN[0]=excel_file_path, IN[1]=sheet_name, IN[2]=show_excel)  # IronPython2
# ---------- python_script.python (48 lines) ----------
import clr, time
clr.AddReference("Microsoft.Office.Interop.Excel")
# from System.Runtime.InteropServices import Marshal
import Microsoft.Office.Interop.Excel as Excel
#---------------------------------------------------------------------------------------#
#---------------------------------------------------------------------------------------#
#---------------------------------------------------------------------------------------#
def write_excel(excel_path,sheet_name,row,column,data):
    global debugger
    excel_app = Excel.ApplicationClass()
    excel_app.Visible = show_excel    
    workbook = excel_app.Workbooks.Open(excel_path)
    worksheets = workbook.Worksheets
    sheet = [worksheets(i+1) for i in range(worksheets.Count) if worksheets(i+1).Name == sheet_name][0]
    

    if data.__class__.__name__ == "str":
        sheet.Cells(row,column).Value = data
    
    
    
    workbook.Close(True,excel_path)

excel_path = IN[0]
sheet_name = IN[1]
show_excel = IN[2]

debugger = []


# write excel:
write_excel(excel_path,sheet_name,10,10,"Data")

# dic_data = {}
# for r in range(1,row+1):
#     try:
#         dic_data[str(r)] = [sheet.Cells(r,c).Text for c in range(1,column+1)]
#         # debugger.append(sheet.Cells(r,column).Text)
#     except:
#         pass


OUT = "string".__class__.__name__


# if not show_excel:
# 	time.sleep(5)
# 	excel_app.Quit()
# ----------------------------------------
watch = Watch(python_script)
exportExcel = Data.ExportExcel()  # unwired: filePath, sheetName, startRow, startCol, data
importExcel = Data.ImportExcel()  # unwired: file, sheetName
